# Grasshopper definition all.gh (Grasshopper 1.0.8)
# plug-ins: Human

file = ReadFile(File="G:\マイドライブ\研究\変更分析\BIM\Grasshopper\scripts_gh\pier\const_foundation.py", PerLineParse=False)
file_2 = ReadFile(File="G:\マイドライブ\研究\変更分析\BIM\Grasshopper\scripts_gh\bake.py", PerLineParse=False)
layertable = LayerTable(Update=True, AutoUpdate=False)  # -> Layers, FullLayerPaths, LayerColors, Linetypes, MaterialNames, Visible, PrintWidth, PrintColor
py3 = Python3Script(script=file)  # -> out, bake_keys, bake_objs; unedited script template
panel = Panel(layertable.Layers)
py3_2 = Python3Script(script=file_2, keys=py3.bake_keys, values=py3.bake_objs, layer_index=Slider(9, range=0..10))  # -> out, result; inputs keys: list of String, values: list of Brep; unedited script template
panel_2 = Panel(py3.out)
